# Grasshopper definition point_tags.gh (Grasshopper 1.0.7)

pt = Point()
pt_2 = Point([<point referenced from the Rhino model> x2124])
pdecon = Deconstruct(Point=pt)  # -> XComponent, YComponent, ZComponent
prox = Proximity3D(Group=5)  # -> Links, Topology
X = UnitX(Factor=Slider(1.476, range=0..15))
Y = UnitY(Factor=Slider(0.812, range=0..5))
pt_3 = ConstructPoint(XCoordinate=pdecon.XComponent, YCoordinate=pdecon.YComponent, ZCoordinate=pdecon.ZComponent)
vec = VectorXYZ(XComponent=X, YComponent=Y, ZComponent=0)  # -> Vector, Length
move = Move(Geometry=pt, Motion=vec.Vector)  # -> Geometry, Transform
tag = TextTag3D(Location=move.Geometry, Text=pt_3, Size=Slider(3, range=0..10), Justification=7)
