# Grasshopper definition vive_position_points.gh (Grasshopper 1.0.7)
# plug-ins: EleFront, ViveTrack

startvive = StartVive(AutoUpdate=True)  # -> Msg, Vive
tracker = Tracker(Vive=startvive.Vive, Index=0, Pause=False)  # -> Tracker, Plane, Matrix
hmd = ViveHMD(Pause=False)  # -> HMD, Plane, Matrix
panel = Panel(startvive.Msg)
pdecon = Deconstruct(Point=tracker.Plane)  # -> XComponent, YComponent, ZComponent
toggle = BooleanToggle(False)
pt = ConstructPoint(XCoordinate=pdecon.XComponent, YCoordinate=pdecon.YComponent, ZCoordinate=pdecon.ZComponent)
bake = BakeObjects(Geometry=pt, Bake=False)
prox = Proximity3D(Group=5)  # -> Links, Topology
